# Grasshopper definition main.gh (Grasshopper 1.0.8)

path = FilePath("/Users/sanghoon/Documents/GitHub/BuildableRegionGenrator/data/Gangnam.shp")
list = ValueList({"1168010800100880001", "1168010800100880007", "1168010800100880008", "1168010800100880009", "1168010800100880011"}, selected="1168010800100880001")
py3 = Python3Script(script=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, shp_dir=path)  # -> out; disabled; unedited script template
panel = Panel(py3)
py3_2 = Python3Script(script=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, shp_path=path, pnu="1168010600109000052")  # -> out, target_lot, other_lots; inputs pnu: String; unedited script template
py3_3 = Python3Script(lot=py3_2.target_lot, lots=py3_2.other_lots)  # -> out, bd, crvs, a; inputs lots: list
# ---------- py3_3: Python ----------
crvs = [lot.region for lot in lots]
bd = lot.region
a = [lot.region for lot in lots if lot.landuse_code == '13' or lot.landuse_code == '14' or lot.landuse_code == '15']

print(len(crvs), len(a))
# ---------- end py3_3 ----------
panel_2 = Panel(py3_2.out)
boundary = BoundarySurfaces(Edges=py3_3.a)
py3_4 = Python3Script(script=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, target_lot=py3_2.target_lot, other_lots=py3_2.other_lots, height=Slider(10, range=1..20))  # -> out, northsky_base_segments, northsky_buildable_boundary, offset_lot_region, northsky_cutter_breps; inputs other_lots: list, height: Double; unedited script template
geo = Geometry(py3_4.northsky_buildable_boundary)
panel_3 = Panel(py3_4.out)
py3_5 = Python3Script()  # -> out, a, b, c
# ---------- py3_5: Python ----------
import scriptcontext as sc
import utils

a,b,c = sc.sticky["lot_region_inward"]

print(a,b,c)
# ---------- end py3_5 ----------
pipe = Pipe(Radius=1, Caps=0, FitRail=False)
